# Grasshopper definition ComponentTests.gh (Grasshopper 1.0.7)
# plug-ins: AutoVisualizer

# ----
# Cozy cottage in the woods
# {"prompt":null,"negative_prompt":null,"styles":null,"seed":-1.0,"sampler_name":"Euler a","batch_size":1,"n_iter":1,"steps":50,"cfg_scale":7.0,"width":512,"height":512,"tiling":null,"do_not_save_samples":false,"do_not_save_grid":false,"denoising_strength":0.0,"disable_extra_networks":false,"enable_hr":false,"hr_scale":2.0,"sampler_index":"Euler","send_images":true,"save_images":false}
panel = Panel("Unrealistic")
button = Button()
sdgenerateasync = SDGenerateASync(Generate=False)  # -> Path, Image
sdgeneratesync = SDGenerateSync(Generate=False)
panel_2 = Panel(sdgenerateasync.Image)
panel_3 = Panel(sdgeneratesync)
panel_4 = Panel(sdgenerateasync.Path)

sdgeneratesettingsessential = SDGenerateSettingsEssential(
    Seed=-1,
    SamplerName="Euler a",
    Batch_size=1,
    N_iter=1,
    Steps=50,
    Cfg_scale=7,
    Width=512,
    Height=512,
    Do_not_save_samples=False,
    Do_not_save_grid=False,
    Denoising_strength=0,
    Disable_extra_networks=False,
    Enable_hr=False,
    Hr_scale=2,
    Sampler_index="Euler",
    Send_images=True,
    Save_images=False)
panel_5 = Panel(sdgeneratesettingsessential)
sdgeneratesettingsbasic = SDGenerateSettingsBasic(
    Seed=-1,
    Subseed=-1,
    SubseedStrength=0,
    SeedResizeFromH=-1,
    SeedResizeFromW=-1,
    SamplerName="Euler a",
    Batch_size=1,
    N_iter=1,
    Steps=50,
    Cfg_scale=7,
    Width=512,
    Height=512,
    Restore_faces=True,
    Do_not_save_samples=False,
    Do_not_save_grid=False,
    Denoising_strength=0,
    Override_settings_restore_afterwards=True,
    Disable_extra_networks=False,
    Enable_hr=False,
    Hr_scale=2,
    Sampler_index="Euler",
    Send_images=True,
    Save_images=False)
panel_6 = Panel(sdgeneratesettingsbasic)
sdgeneratesettingsfull = SDGenerateSettingsFull(
    Seed=-1,
    Subseed=-1,
    SubseedStrength=0,
    SeedResizeFromH=-1,
    SeedResizeFromW=-1,
    SamplerName="Euler a",
    Batch_size=1,
    N_iter=1,
    Steps=50,
    Cfg_scale=7,
    Width=512,
    Height=512,
    Restore_faces=True,
    Do_not_save_samples=False,
    Do_not_save_grid=False,
    Denoising_strength=0,
    Override_settings_restore_afterwards=True,
    Disable_extra_networks=False,
    Enable_hr=False,
    Firstphase_width=0,
    Firstphase_height=0,
    Hr_scale=2,
    Hr_second_pass_steps=0,
    Hr_resize_x=0,
    Hr_resize_y=0,
    Sampler_index="Euler",
    Send_images=True,
    Save_images=False,
    Alwayson_scripts="{}")
panel_7 = Panel(sdgeneratesettingsfull)
