# Grasshopper definition ControlNetTest.gh (Grasshopper 1.0.7)
# plug-ins: AutoVisualizer, LadybugGrasshopper

captureoptions = CaptureOptions(Grid=True, WorldAxes=True, CPlaneAxes=True)
captureviewport = CaptureViewport(Options=captureoptions, Capture=Button())  # -> BitmapImage, ImagePath
controlnetrequest = ControlNetRequest(
    Image=captureviewport.BitmapImage,
    Module="canny",
    Model="control_v11p_sd15_canny [d14c016b]",
    Weight=1,
    Resize_mode=1,
    Lowvram=False,
    Processor_res=64,
    Threshold_a=64,
    Threshold_b=64,
    Guidance_start=0,
    Guidance_end=1,
    Contol_mode=0,
    Pixel_perfect=False)
lb_imageviewer = LBImageViewer(ImagePath_=captureviewport.ImagePath, _scale_=1, DisableClickable=False, SaveImgWithCoords=False, scale=1)  # -> ImagePath, Values, GIF
sdgeneratesettingsfull = SDGenerateSettingsFull(
    Seed=-1,
    Subseed=-1,
    SubseedStrength=0,
    SeedResizeFromH=-1,
    SeedResizeFromW=-1,
    SamplerName="Euler a",
    Batch_size=1,
    N_iter=1,
    Steps=50,
    Cfg_scale=7,
    Width=512,
    Height=512,
    Restore_faces=True,
    Do_not_save_samples=False,
    Do_not_save_grid=False,
    Denoising_strength=0,
    Override_settings_restore_afterwards=True,
    Disable_extra_networks=False,
    Enable_hr=False,
    Firstphase_width=0,
    Firstphase_height=0,
    Hr_scale=2,
    Hr_second_pass_steps=0,
    Hr_resize_x=0,
    Hr_resize_y=0,
    Sampler_index="Euler",
    Send_images=True,
    Save_images=False,
    Alwayson_scripts=controlnetrequest)
controlnet_to_sdoptions = ControlNet_to_SDOptions(ControlNetRequest=controlnetrequest)
sdgenerateasync = SDGenerateASync(Prompt="singular skyscraper in the desert", Options=sdgeneratesettingsfull, Generate=False)  # -> Path, Image
lb_imageviewer_2 = LBImageViewer(ImagePath_=sdgenerateasync.Path, _scale_=1, DisableClickable=False, SaveImgWithCoords=False, scale=1)  # -> ImagePath, Values, GIF
